# Dynamo custom node AIChat.dyf (Dynamo 2.19.3.6394)
# category: ArchAI.Common
# Lightweight AI Q&A node for real-time natural language consultation | 轻量 AI 智能问答节点，支持自然语言即时对话答疑

api_key = Input(api_key: string)  # API Keys, Default to DeepSeek API 密钥，默认为 DeepSeek 模型
user_query = Input(user_query: string)  # Query Prompt 查询指令
python_script = Python(IN[0]=api_key, IN[1]=user_query)  # CPython3
# ---------- python_script.python (90 lines) ----------
import sys
import os

# 必须和Packages下的包文件夹名完全一致（大小写敏感）
PACKAGE_NAME = "ArchAI"
OUT = ""  # 初始化OUT，避免未定义

# ===================== 1. 自动定位节点包的根路径 =====================
# 获取APPDATA路径
appdata = os.environ.get("APPDATA")
# 定位Dynamo Revit根目录
dynamo_root = os.path.join(appdata, "Dynamo", "Dynamo Revit")
if not os.path.isdir(dynamo_root):
    print(f"Dynamo根目录不存在 - {dynamo_root}")
# 遍历版本目录，查找包路径
lib_path = None
try:
    for version_dir in os.listdir(dynamo_root):
        version_path = os.path.join(dynamo_root, version_dir)
        # 跳过非目录
        if not os.path.isdir(version_path):
            continue
        temp_lib = os.path.join(version_path, "Packages", PACKAGE_NAME)
        # 找到第一个有效路径就停止
        if os.path.exists(temp_lib):
            lib_path = temp_lib
            break
except OSError as e:
    print(f"遍历目录时出错：{str(e)}")

def get_package_lib_path():
    if lib_path not in sys.path:
        sys.path.append(lib_path)
    return lib_path, f"lib路径：{lib_path}" if lib_path else "未找到包的节点包目录"

# 初始化路径
get_package_lib_path()

# ===================== 2. 读取与验证输入（提前做，避免依赖加载后报错） =====================
# 先验证输入，再加载依赖，减少异常
api_key = IN[0].strip() if (len(IN) > 0 and IN[0] and isinstance(IN[0], str)) else ""
user_query = IN[1].strip() if (len(IN) > 1 and IN[1] and isinstance(IN[1], str)) else ""

# 输入验证（失败直接返回，不加载依赖）
if not api_key:
    OUT = "IN[0] 需要有效的API Key字符串"
elif not user_query:
    OUT = "IN[1] 需要有效的问题字符串"
else:
    # ===================== 3. 加载路径+导入openai（仅在输入有效时执行） =====================
    # 把元组的第1个元素赋值给lib_path，第2个赋值给path_msg
    lib_path, path_msg = get_package_lib_path()
    print(f"【路径验证】{path_msg}")

    openai_loaded = False
    # 清理缓存，避免加载旧版本
    if "openai" in sys.modules.keys():
        del sys.modules["openai"]
    # 核心：把导入逻辑完全放进try里，启动时不会触发
    try:
        # 从 ./extra/lib 中导入openai库；从 ./librevit_mcp_tools 导入配置
        from extra.lib.openai import OpenAI
        from revit_mcp_tools.config import BASE_URL, MODEL
        
        print("openai导入成功")
        openai_loaded = True
    except Exception as e:
        OUT = f"openai导入失败：{type(e).__name__} - {str(e)}"
        print(OUT)

    # ===================== 4. 调用 DeepSeek API（仅在依赖加载成功时执行） =====================
    if openai_loaded:
        system_message = "You are a helpful assistant"
        try:
            client = OpenAI(api_key=api_key, base_url= BASE_URL)
            response = client.chat.completions.create(
                model= MODEL,
                messages=[{"role":"system","content":system_message},{"role":"user","content":user_query}],
                stream=False
            )
            OUT = response.choices[0].message.content
        except Exception as e:
            OUT = f"API 调用失败：{str(e)}"
            print(OUT)
    elif not openai_loaded and not OUT:
        OUT = "未加载到openai模块，无法调用API"
        print(OUT)

# 最终输出（确保OUT始终有值）
print(f"最终结果：{OUT}")
# ----------------------------------------
Markdown = Output(python_script)  # AI-Generated Result 返回 AI 生成的结果
