# Dynamo custom node RandomGeneration.dyf (Dynamo 2.19.3.6394)
# category: ArchAI.Modeling
# AI-driven random generation with uncertain outputs | AI 随机生成，输出具备不确定性

api_key = Input(api_key: string)  # API Keys, Default to DeepSeek API 密钥，默认为 DeepSeek 模型
user_query = Input(user_query: string)  # Query Prompt 查询指令
python_script = Python(IN[0]=api_key, IN[1]=user_query)  # CPython3
# ---------- python_script.python (134 lines) ----------
import sys
import os

# 必须和Packages下的包文件夹名完全一致（大小写敏感）
PACKAGE_NAME = "ArchAI"
OUT = ""  # 初始化OUT，避免未定义

# ===================== 1. 自动定位节点包的根路径 =====================
# 获取APPDATA路径
appdata = os.environ.get("APPDATA")
# 定位Dynamo Revit根目录
dynamo_root = os.path.join(appdata, "Dynamo", "Dynamo Revit")
if not os.path.isdir(dynamo_root):
    print(f"Dynamo根目录不存在 - {dynamo_root}")
# 遍历版本目录，查找包路径
lib_path = None
try:
    for version_dir in os.listdir(dynamo_root):
        version_path = os.path.join(dynamo_root, version_dir)
        # 跳过非目录
        if not os.path.isdir(version_path):
            continue
        temp_lib = os.path.join(version_path, "Packages", PACKAGE_NAME)
        # 找到第一个有效路径就停止
        if os.path.exists(temp_lib):
            lib_path = temp_lib
            break
except OSError as e:
    print(f"遍历目录时出错：{str(e)}")

def get_package_lib_path():
    if lib_path not in sys.path:
        sys.path.append(lib_path)
    return lib_path, f"lib路径：{lib_path}" if lib_path else "未找到包的节点包目录"

# 初始化路径
get_package_lib_path()

# ===================== 2. 读取与验证输入（提前做，避免依赖加载后报错） =====================
# 先验证输入，再加载依赖，减少异常
api_key = IN[0].strip() if (len(IN) > 0 and IN[0] and isinstance(IN[0], str)) else ""
user_query = IN[1].strip() if (len(IN) > 1 and IN[1] and isinstance(IN[1], str)) else ""

# 输入验证（失败直接返回，不加载依赖）
if not api_key:
    OUT = "IN[0] 需要有效的API Key字符串"
elif not user_query:
    OUT = "IN[1] 需要有效的问题字符串"
else:
    # ===================== 3. 加载路径+导入openai（仅在输入有效时执行） =====================
    # 把元组的第1个元素赋值给lib_path，第2个赋值给path_msg
    lib_path, path_msg = get_package_lib_path()
    print(f"【路径验证】{path_msg}")

    openai_loaded = False
    # 清理缓存，避免加载旧版本
    if "openai" in sys.modules.keys():
        del sys.modules["openai"]
    # 核心：把导入逻辑完全放进try里，启动时不会触发
    try:
        # 从 ./extra/lib 中导入openai库；从 ./librevit_mcp_tools 导入配置
        from extra.lib.openai import OpenAI
        from revit_mcp_tools.config import BASE_URL, MODEL
        
        print("openai导入成功")
        openai_loaded = True
    except Exception as e:
        OUT = f"openai导入失败：{type(e).__name__} - {str(e)}"
        print(OUT)

    # ===================== 4. 调用 DeepSeek API（仅在依赖加载成功时执行） =====================
    if openai_loaded:
        system_message = f"""
你是专业的Revit Dynamo PythonScript代码生成助手，仅输出可运行的纯代码，不包含任何解释、说明文字或额外文本。绝对遵循以下规则：
【规则1】：禁止使用Pyrevit代码、ironpython、Revit MCP代码，严格使用原生Revit API，版本为Revit 2024。
【规则2】：所有尺寸参数必须通过Revit API的UnitUtils.ConvertToInternalUnits方法将米（m）、毫米(mm)、厘米(cm)转换为英尺。
【规则3】：为避免错误，必须使用以下的固定导入内容（自行去掉退格缩进），禁止自行导入其他内容：
        import sys
        import os
        import math
        import json
        import clr
        
        import clr
        clr.AddReference('ProtoGeometry')
        from Autodesk.DesignScript.Geometry import *
        clr.AddReference('DSCoreNodes')
        import DSCore  # 为避免冲突，使用DSCore.List.XX
        clr.AddReference('RevitNodes')
        import Revit   # 为避免冲突，使用Revit.Elements.XX
        clr.ImportExtensions(Revit.Elements)
        clr.ImportExtensions(Revit.GeometryConversion)
        
        clr.AddReference('RevitAPI')
        clr.AddReference('RevitAPIUI')
        from Autodesk.Revit.DB import *
        from Autodesk.Revit.UI import *
        from System.Collections.Generic import *
        
        clr.AddReference("RevitServices")
        import RevitServices
        from RevitServices.Persistence import DocumentManager
        from RevitServices.Transactions import TransactionManager
        
        doc = DocumentManager.Instance.CurrentDBDocument
        app = doc.Application
        uiApp = DocumentManager.Instance.CurrentUIApplication
        uidoc = uiApp.ActiveUIDocument

【规则4】：为避免错误，必须使用以下固定格式（自行去掉退格缩进），禁止自行修改：
        固定导入内容
        TransactionManager.Instance.EnsureInTransaction(doc)
        你的代码
        TransactionManager.Instance.TransactionTaskDone()
【规则5】：参数不全时，使用OUT输出，直接向用户索要必填参数，不说多余的话。
【规则6】：非Revit代码生成需求，直接拒绝。
"""
        try:
            client = OpenAI(api_key=api_key, base_url= BASE_URL)
            response = client.chat.completions.create(
                model= MODEL,
                messages=[{"role":"system","content":system_message},{"role":"user","content":user_query}],
                stream=False
            )
            OUT = response.choices[0].message.content
        except Exception as e:
            OUT = f"API 调用失败：{str(e)}"
            print(OUT)
    elif not openai_loaded and not OUT:
        OUT = "未加载到openai模块，无法调用API"
        print(OUT)

# 最终输出（确保OUT始终有值）
print(f"最终结果：{OUT}")
# ----------------------------------------
python_script_2 = Python(IN[0]=python_script)  # CPython3
# ---------- python_script_2.python (36 lines) ----------
import re

def clean_script_string(raw):
    # 去除首尾空白以便检查标记（但不影响最终输出）
    stripped = raw.strip()
    
    # 检查是否包含开头标记（[ 或 ```python）或结尾标记（] 或 ```）
    has_prefix = stripped.startswith('[') or stripped.startswith('```python')
    has_suffix = stripped.endswith(']') or stripped.endswith('```')
    
    if has_prefix or has_suffix:
        # 第一部分：匹配开头的存在包裹标记
        # ^:匹配字符串的开头
        # \s*:匹配开头的任意数量空白字符（包括换行）
        # (\[\s*)?:可选地匹配 [ 及其后面的空白字符
        # ```python：匹配markdown代码块的开头标记
        # \s*：匹配代码标记块的任意数量空白字符
        # |：或者
        # 第二部分：匹配结尾的包裹标记
        # \s*:匹配代码块结束标志前的任意数量空白字符
        # ```：匹配markdown代码块的结束标记
        # \s*：匹配代码标记块结束后的任意数量空白字符
        # (\[\s*)?：可选地匹配 ] 及其后面的空白字符
        # $：匹配字符串的结尾
        pattern = r'^\s*(\[\s*)?```python\s*|\s*```\s*(\]\s*)?$'
        cleaned = re.sub(pattern, '', raw, flags=re.DOTALL)
        return cleaned.strip()   # 清理后去除首尾空白，得到纯净代码
    else:
        # 没有检测到包裹标记，直接返回原始字符串（保留原格式，包括首尾空白）
        return raw

raw_str = IN[0]
if raw_str is None or not isinstance(raw_str, str):
    OUT = ""   # 输入无效时返回空字符串
else:
    OUT = clean_script_string(raw_str)
# ----------------------------------------
Script = Output(python_script_2)  # AI-Generated Script 返回 AI 生成的代码
python_script_from_string = PythonStringNode(script=python_script_2)  # CPython3
Result = Output(python_script_from_string)  # AI-Generated Result 返回 AI 生成的结果
